# Grasshopper definition finalproject.gh (Grasshopper 1.0.8)

# ---- group: First Image / Creates pixel plane
y_size = Slider(50, range=0..100)
pixel_size = Slider(3, range=1..5)
x_size = Slider(50, range=0..100)
division = Division(A=x_size, B=pixel_size)
division_2 = Division(A=y_size, B=pixel_size)
plane_surface = PlaneSurface(Plane=PlaneXY(0, 0, 0), XSize=x_size, YSize=y_size)  # -> reparameterize(Plane)
divide_surface = DivideSurface(Surface=plane_surface, UCount=division, VCount=division_2)  # -> Points, Normals, Parameters

# ---- group: Second Image / Creates pixel plane
z_size = Slider(50, range=0..100)
pixel_size_2 = Slider(3, range=1..5)
yz_plane = YZPlane(Origin=Point(0, 0, 0))
division_3 = Division(A=y_size, B=pixel_size_2)
division_4 = Division(A=z_size, B=pixel_size_2)
plane_surface_2 = PlaneSurface(Plane=yz_plane, XSize=y_size, YSize=z_size)  # -> reparameterize(Plane)
divide_surface_2 = DivideSurface(Surface=plane_surface_2, UCount=division_3, VCount=division_4)  # -> Points, Normals, Parameters

# ----
data_dam = DataDam(DataDataA=z_size, BufferDelay=10000000, BufferMode=0)
boolean_toggle = BooleanToggle(True)

# ---- group: First Image
image_sampler = ImageSampler(
    divide_surface.Parameters,
    FilePath="C:\Users\Ashley\Downloads\jerma20.png",
    Filter="Value",
    Interpolate=False,
    Umax=1,
    Umin=0,
    Vmax=1,
    Vmin=0,
    Wrap=1)
full_pixel_range = Slider(0.3, range=0..1)
smaller_than = SmallerThan(FirstNumber=image_sampler, SecondNumber=full_pixel_range)  # -> SmallerThan, OrEqualTo
unit_z = UnitZ(Factor=data_dam)

# ---- group: First Image / Half Pixel List
dispatch = Dispatch(List=image_sampler, DispatchPattern=smaller_than.SmallerThan)  # -> ListA, ListB
half_pixel_range = Slider(0.8, range=0..1)
smaller_than_2 = SmallerThan(FirstNumber=dispatch.ListB, SecondNumber=half_pixel_range)  # -> SmallerThan, OrEqualTo
cull_pattern = CullPattern(List=divide_surface.Points, CullPattern=smaller_than_2.SmallerThan)

# ---- group: First Image / Construct X Line / Construct X Points
deconstruct = Deconstruct(Point=cull_pattern)  # -> XComponent, YComponent, ZComponent
division_5 = Division(A=pixel_size, B="3")
addition = Addition(A=division_5, B=deconstruct.XComponent)
construct_point = ConstructPoint(XCoordinate=addition, YCoordinate=deconstruct.YComponent, ZCoordinate=deconstruct.ZComponent)
multiplication = Multiplication(A=division_5, B="2")

# ---- group: First Image / Construct X Line
addition_2 = Addition(A=multiplication, B=deconstruct.XComponent)
construct_point_2 = ConstructPoint(XCoordinate=addition_2, YCoordinate=deconstruct.YComponent, ZCoordinate=deconstruct.ZComponent)
line = Line(StartPoint=construct_point, EndPoint=construct_point_2)
unit_y = UnitY(Factor=pixel_size)
extrude = Extrude(Base=line, Direction=unit_y)

# ---- group: First Image / Construct Y Line / Construct Y Points
addition_3 = Addition(A=division_5, B=deconstruct.YComponent)
addition_4 = Addition(A=multiplication, B=deconstruct.YComponent)
construct_point_3 = ConstructPoint(XCoordinate=deconstruct.XComponent, YCoordinate=addition_3, ZCoordinate=deconstruct.ZComponent)
construct_point_4 = ConstructPoint(XCoordinate=deconstruct.XComponent, YCoordinate=addition_4, ZCoordinate=deconstruct.ZComponent)

# ---- group: First Image / Construct Y Line
unit_x = UnitX(Factor=pixel_size)
line_2 = Line(StartPoint=construct_point_3, EndPoint=construct_point_4)
extrude_2 = Extrude(Base=line_2, Direction=unit_x)

# ----
data_dam_2 = DataDam(DataDataA=division_5, BufferDelay=10000000, BufferMode=0)
subtraction = Subtraction(A=data_dam_2, B="0.2")

# ---- group: Second Image
image_sampler_2 = ImageSampler(
    divide_surface_2.Parameters,
    FilePath="C:\Users\Ashley\Downloads\jermb20.png",
    Filter="Value",
    Interpolate=False,
    Umax=1,
    Umin=0,
    Vmax=1,
    Vmin=0,
    Wrap=1)
full_pixel_range_2 = Slider(0.2, range=0..1)
smaller_than_3 = SmallerThan(FirstNumber=image_sampler_2, SecondNumber=full_pixel_range_2)  # -> SmallerThan, OrEqualTo
data_dam_3 = DataDam(DataDataA=x_size, BufferDelay=10000000, BufferMode=0)
unit_x_2 = UnitX(Factor=data_dam_3)

# ---- group: Second Image / Half Pixel List
dispatch_2 = Dispatch(List=image_sampler_2, DispatchPattern=smaller_than_3.SmallerThan)  # -> ListA, ListB
half_pixel_range_2 = Slider(0.8, range=0..1)
smaller_than_4 = SmallerThan(FirstNumber=dispatch_2.ListB, SecondNumber=half_pixel_range_2)  # -> SmallerThan, OrEqualTo
cull_pattern_2 = CullPattern(List=divide_surface_2.Points, CullPattern=smaller_than_4.SmallerThan)

# ---- group: Second Image / Construct X Line / Construct X Points
deconstruct_2 = Deconstruct(Point=cull_pattern_2)  # -> XComponent, YComponent, ZComponent
division_6 = Division(A=pixel_size_2, B="3")
addition_5 = Addition(A=division_6, B=deconstruct_2.YComponent)
construct_point_5 = ConstructPoint(XCoordinate=deconstruct_2.XComponent, YCoordinate=addition_5, ZCoordinate=deconstruct_2.ZComponent)
multiplication_2 = Multiplication(A=division_6, B="2")

# ---- group: Second Image / Construct X Line
addition_6 = Addition(A=multiplication_2, B=deconstruct_2.YComponent)
construct_point_6 = ConstructPoint(XCoordinate=deconstruct_2.XComponent, YCoordinate=addition_6, ZCoordinate=deconstruct_2.ZComponent)
unit_z_2 = UnitZ(Factor=pixel_size_2)
line_3 = Line(StartPoint=construct_point_5, EndPoint=construct_point_6)
extrude_3 = Extrude(Base=line_3, Direction=unit_z_2)

# ---- group: Second Image / Construct Y Line / Construct Y Points
addition_7 = Addition(A=division_6, B=deconstruct_2.ZComponent)
addition_8 = Addition(A=multiplication_2, B=deconstruct_2.ZComponent)
construct_point_7 = ConstructPoint(XCoordinate=deconstruct_2.XComponent, YCoordinate=deconstruct_2.YComponent, ZCoordinate=addition_7)
construct_point_8 = ConstructPoint(XCoordinate=deconstruct_2.XComponent, YCoordinate=deconstruct_2.YComponent, ZCoordinate=addition_8)

# ---- group: Second Image / Construct Y Line
unit_y_2 = UnitY(Factor=pixel_size_2)
line_4 = Line(StartPoint=construct_point_7, EndPoint=construct_point_8)
extrude_4 = Extrude(Base=line_4, Direction=unit_y_2)

# ---- group: First Image / Constructs pixels
cull_pattern_3 = CullPattern(List=divide_surface.Points, CullPattern=smaller_than.SmallerThan)
unit_y_3 = UnitY(Factor=pixel_size)

# ---- group: First Image / Constructs pixels / Constructs second point
deconstruct_3 = Deconstruct(Point=cull_pattern_3)  # -> XComponent, YComponent, ZComponent
addition_9 = Addition(A=pixel_size, B=deconstruct_3.XComponent)
construct_point_9 = ConstructPoint(XCoordinate=addition_9, YCoordinate=deconstruct_3.YComponent, ZCoordinate=deconstruct_3.ZComponent)

# ---- group: First Image / Constructs pixels (continued)
line_5 = Line(StartPoint=construct_point_9, EndPoint=cull_pattern_3)
extrude_5 = Extrude(Base=line_5, Direction=unit_y_3)

# ---- group: First Image (continued)
merge = Merge(Data1=extrude, Data2=extrude_2, Data3=extrude_5)
data_dam_4 = DataDam(DataDataA=merge, BufferDelay=10000000, BufferMode=0)
extrude_6 = Extrude(Base=data_dam_4, Direction=unit_z)

# ----
data_dam_5 = DataDam(DataDataA=extrude_6, BufferDelay=10000000, BufferMode=0)
flatten_tree = FlattenTree(Tree=data_dam_5, Path="{0}")
shrinkwrap = ShrinkWrap(Geometry=flatten_tree, EdgeLength=subtraction, Offset=0, Smoothing=0, Optimization=10, FillHoles=boolean_toggle)

# ---- group: Second Image / Constructs pixels
cull_pattern_4 = CullPattern(List=divide_surface_2.Points, CullPattern=smaller_than_3.SmallerThan)
unit_z_3 = UnitZ(Factor=pixel_size_2)

# ---- group: Second Image / Constructs pixels / Constructs second point
deconstruct_4 = Deconstruct(Point=cull_pattern_4)  # -> XComponent, YComponent, ZComponent
addition_10 = Addition(A=pixel_size_2, B=deconstruct_4.YComponent)
construct_point_10 = ConstructPoint(XCoordinate=deconstruct_4.XComponent, YCoordinate=addition_10, ZCoordinate=deconstruct_4.ZComponent)

# ---- group: Second Image / Constructs pixels (continued)
line_6 = Line(StartPoint=construct_point_10, EndPoint=cull_pattern_4)
extrude_7 = Extrude(Base=line_6, Direction=unit_z_3)

# ---- group: Second Image (continued)
merge_2 = Merge(Data1=extrude_3, Data2=extrude_4, Data3=extrude_7)
data_dam_6 = DataDam(DataDataA=merge_2, BufferDelay=10000000, BufferMode=0)
extrude_8 = Extrude(Base=data_dam_6, Direction=unit_x_2)

# ----
data_dam_7 = DataDam(DataDataA=extrude_8, BufferDelay=10000000, BufferMode=0)
flatten_tree_2 = FlattenTree(Tree=data_dam_7, Path="{0}")
shrinkwrap_2 = ShrinkWrap(Geometry=flatten_tree_2, EdgeLength=subtraction, Offset=0, Smoothing=0, Optimization=10, FillHoles=boolean_toggle)
mesh_intersection = MeshIntersection(MeshesA=shrinkwrap, MeshesB=shrinkwrap_2)
