# Grasshopper definition furniture.gh (Grasshopper 1.0.8)

# ---- group: Construct Table Top
top_height = Slider(4, range=1..10)
top_segments = Slider(3, range=3..10)
leg_height = Slider(10, range=1..10)
top_radius = Slider(4, range=3..10)
construct_point = ConstructPoint(XCoordinate=0, YCoordinate=0, ZCoordinate=leg_height)
addition = Addition(A=leg_height, B=top_height)
construct_plane = ConstructPlane(Origin=construct_point, XAxis=Vector(1, 0, 0), YAxis=Vector(0, 1, 0))
unit_z = UnitZ(Factor=top_height)
polygon = Polygon(Plane=construct_plane, Radius=top_radius, Segments=top_segments, FilletRadius=0)  # -> Polygon, Length
extrude = Extrude(Base=polygon.Polygon, Direction=unit_z)
cap_holes = CapHoles(Brep=extrude)

# ---- group: Construct Bounding Box and Center Line
polygon_2 = Polygon(Plane=PlaneXY(0, 0, 0), Radius=top_radius, Segments=top_segments, FilletRadius=0)  # -> Polygon, Length
unit_z_2 = UnitZ(Factor=addition)
extrude_2 = Extrude(Base=polygon_2.Polygon, Direction=unit_z_2)
area = Area(Geometry=extrude_2)  # -> Area, Centroid
bounding_box = BoundingBox(Content=extrude_2, Plane=PlaneXY(0, 0, 0))  # -> Box, Box_2
deconstruct = Deconstruct(Point=area.Centroid)  # -> XComponent, YComponent, ZComponent
deconstruct_box = DeconstructBox(Box=bounding_box.Box)  # -> Plane, X, Y, Z
deconstruct_domain = DeconstructDomain(Domain=deconstruct_box.Z)  # -> Start, End
construct_point_2 = ConstructPoint(XCoordinate=deconstruct.XComponent, YCoordinate=deconstruct.YComponent, ZCoordinate=deconstruct_domain.Start)
construct_point_3 = ConstructPoint(XCoordinate=deconstruct.XComponent, YCoordinate=deconstruct.YComponent, ZCoordinate=deconstruct_domain.End)
line = Line(StartPoint=construct_point_2, EndPoint=construct_point_3)

# ----
addition_2 = Addition(A=leg_height, B="0.5")

# ---- group: Construct Table Legs
division = Division(A="360", B=top_segments)
series = Series(Start=0, Step=1, Count=top_segments)
radians = Radians(Degrees=division)
leg_radius = Slider(1.404, range=1..3)
multiplication = Multiplication(A=radians, B=series)
cosine = Cosine(Value=multiplication)
sine = Sine(Value=multiplication)
subtraction = Subtraction(A=top_radius, B=leg_radius)
multiplication_2 = Multiplication(A=subtraction, B=cosine)
multiplication_3 = Multiplication(A=subtraction, B=sine)
construct_point_4 = ConstructPoint(XCoordinate=multiplication_2, YCoordinate=multiplication_3, ZCoordinate=0)
construct_plane_2 = ConstructPlane(Origin=construct_point_4, XAxis=Vector(1, 0, 0), YAxis=Vector(0, 1, 0))
leg_segments = Slider(6, range=3..10)
polygon_3 = Polygon(Plane=construct_plane_2, Radius=leg_radius, Segments=leg_segments, FilletRadius=0)  # -> Polygon, Length
unit_z_3 = UnitZ(Factor=addition_2)
extrude_3 = Extrude(Base=polygon_3.Polygon, Direction=unit_z_3)
cap_holes_2 = CapHoles(Brep=extrude_3)

# ---- group: Twists and Merges Table
merge = Merge(Data1=cap_holes, Data2=cap_holes_2)
flatten_tree = FlattenTree(Tree=merge, Path="{0}")
twist_angle = Slider(-10, range=-10..10)
solid_union = SolidUnion(Breps=flatten_tree)
twist = Twist(Geometry=solid_union, Axis=line, Angle=twist_angle, Infinite=False, Rigid=False)
