# Grasshopper definition l2task1.gh (Grasshopper 1.0.8)

shape_count = Slider(7, range=0..10)

# ---- group: Random XY Points
rand_range = Slider(11, range=0..15)
rand_seed_2 = Slider(2, range=0..10)
rand_seed_1 = Slider(0, range=0..10)
random = Random(Range=rand_range, Number=shape_count, Seed=rand_seed_2)
random_2 = Random(Range=rand_range, Number=shape_count, Seed=rand_seed_1)

# ---- group: Z Point Series
z_steps = Slider(8, range=0..10)
series = Series(Start=0, Step=z_steps, Count=shape_count)

# ---- group: Radius Series
radius_start = Slider(6, range=1..10)
radius_steps = Slider(2, range=0..5)
series_2 = Series(Start=radius_start, Step=radius_steps, Count=shape_count)

# ---- group: Segment Amount Series
segment_start = Slider(3, range=3..10)
segment_steps = Slider(2, range=1..3)
series_3 = Series(Start=segment_start, Step=segment_steps, Count=shape_count)

# ---- group: Filet Series
filet_steps = Slider(0, range=0..2)
series_4 = Series(Start=0, Step=filet_steps, Count=shape_count)

# ----
series_5 = Series(Start=0, Step=Slider(0.941, range=0..5), Count=10)

# ---- group: Filet Direction
filet_direction = Slider(1, range=-1..1)
series_6 = Series(Start=0, Step=filet_direction, Count=shape_count)
sort_list = SortList(Keys=series_6, ValuesValuesA=series_4)  # -> Keys, ValuesValuesA

# ---- group: Radius Direction
radius_direction = Slider(1, range=-1..1)
series_7 = Series(Start=0, Step=radius_direction, Count=shape_count)
sort_list_2 = SortList(Keys=series_7, ValuesValuesA=series_2)  # -> Keys, ValuesValuesA

# ---- group: Segment Direction
segment_direction = Slider(-1, range=-1..1)
series_8 = Series(Start=0, Step=segment_direction, Count=shape_count)
sort_list_3 = SortList(Keys=series_8, ValuesValuesA=series_3)  # -> Keys, ValuesValuesA

# ---- group: Construct Polygons
construct_point = ConstructPoint(XCoordinate=random_2, YCoordinate=random, ZCoordinate=series)
xy_plane = XYPlane(Origin=construct_point)
polygon = Polygon(
    Plane=xy_plane,
    Radius=sort_list_2.ValuesValuesA,
    Segments=sort_list_3.ValuesValuesA,
    FilletRadius=sort_list.ValuesValuesA)  # -> Polygon, Length

# ---- group: Make Solid Shape
loft = Loft(Curves=polygon.Polygon, Options={Adjust=False, Closed=False, LoftEnds=0, LoftSimp=0, LoftType=0, Rebuild=10, Refit=0.01})
cap_holes = CapHoles(Brep=loft)
