# Grasshopper definition l2task2.gh (Grasshopper 1.0.8)

shape_count = Slider(8, range=0..10)

# ---- group: Random XY Points
rand_range = Slider(6, range=0..15)
rand_seed_2 = Slider(4, range=0..10)
rand_seed_1 = Slider(1, range=0..10)
random = Random(Range=rand_range, Number=shape_count, Seed=rand_seed_2)
random_2 = Random(Range=rand_range, Number=shape_count, Seed=rand_seed_1)

# ---- group: Z Point Series
z_steps = Slider(10, range=0..10)
series = Series(Start=0, Step=z_steps, Count=shape_count)

# ---- group: Radius Series
radius_start = Slider(10, range=1..10)
radius_steps = Slider(0, range=0..5)
series_2 = Series(Start=radius_start, Step=radius_steps, Count=shape_count)

# ---- group: Segment Amount Series
segment_start = Slider(3, range=3..10)
segment_steps = Slider(1, range=0..3)
series_3 = Series(Start=segment_start, Step=segment_steps, Count=shape_count)

# ---- group: Filet Series
filet_steps = Slider(0, range=0..2)
series_4 = Series(Start=0, Step=filet_steps, Count=shape_count)

# ---- group: Radius Direction
radius_direction = Slider(1, range=-1..1)
series_5 = Series(Start=0, Step=radius_direction, Count=shape_count)
sort_list = SortList(Keys=series_5, ValuesValuesA=series_2)  # -> Keys, ValuesValuesA

# ---- group: Segment Direction
segment_direction = Slider(1, range=-1..1)
series_6 = Series(Start=0, Step=segment_direction, Count=shape_count)
sort_list_2 = SortList(Keys=series_6, ValuesValuesA=series_3)  # -> Keys, ValuesValuesA

# ---- group: Filet Direction
filet_direction = Slider(-1, range=-1..1)
series_7 = Series(Start=0, Step=filet_direction, Count=shape_count)
sort_list_3 = SortList(Keys=series_7, ValuesValuesA=series_4)  # -> Keys, ValuesValuesA

# ---- group: Construct Polygons
construct_point = ConstructPoint(XCoordinate=random_2, YCoordinate=random, ZCoordinate=series)
xy_plane = XYPlane(Origin=construct_point)
polygon = Polygon(
    Plane=xy_plane,
    Radius=sort_list.ValuesValuesA,
    Segments=sort_list_2.ValuesValuesA,
    FilletRadius=sort_list_3.ValuesValuesA)  # -> Polygon, Length

# ---- group: Make Solid Shape
loft = Loft(Curves=polygon.Polygon, Options={Adjust=False, Closed=False, LoftEnds=0, LoftSimp=0, LoftType=0, Rebuild=10, Refit=0.01})
cap_holes = CapHoles(Brep=loft)

# ----
final_shape = Brep(cap_holes)

# ---- group: Contruct/Deconstruct Bounding Box
bounding_box = BoundingBox(Content=final_shape, Plane=PlaneXY(0, 0, 0))  # -> Box, Box_2
area = Area(Geometry=final_shape)  # -> Area, Centroid
deconstruct_box = DeconstructBox(Box=bounding_box.Box)  # -> Plane, X, Y, Z
deconstruct = Deconstruct(Point=area.Centroid)  # -> XComponent, YComponent, ZComponent
deconstruct_domain = DeconstructDomain(Domain=deconstruct_box.Z)  # -> Start, End

# ---- group: Bounding Box X & Y
deconstruct_domain_2 = DeconstructDomain(Domain=deconstruct_box.X)  # -> Start, End
deconstruct_domain_3 = DeconstructDomain(Domain=deconstruct_box.Y)  # -> Start, End
subtraction = Subtraction(A=deconstruct_domain_2.End, B=deconstruct_domain_2.Start)
subtraction_2 = Subtraction(A=deconstruct_domain_3.End, B=deconstruct_domain_3.Start)
maximum = Maximum(A=subtraction, B=subtraction_2)

# ---- group: Slices Into Curves
material_thickness = Slider(3.644, range=0..6)
div_slice_count = Division(A=deconstruct_domain.End, B=material_thickness)
series_8 = Series(Start=0, Step=material_thickness, Count=div_slice_count)
construct_point_2 = ConstructPoint(XCoordinate=deconstruct.XComponent, YCoordinate=deconstruct.YComponent, ZCoordinate=series_8)
xy_plane_2 = XYPlane(Origin=construct_point_2)
polygon_2 = Polygon(Plane=xy_plane_2, Radius=maximum, Segments=6, FilletRadius=0)  # -> Polygon, Length
brep_brep = BrepBrep(BrepA=final_shape, BrepB=polygon_2.Polygon)  # -> Curves, Points
flatten_tree = FlattenTree(Tree=brep_brep.Curves, Path="{0}")

# ---- group: Moves Slices
series_9 = Series(Start=0, Step=subtraction, Count=div_slice_count)
unit_x = UnitX(Factor=series_9)
move = Move(Geometry=flatten_tree, Motion=unit_x)  # -> Geometry, Transform
project = Project(Geometry=move.Geometry, Plane=PlaneXY(0, 0, 0))  # -> Geometry, Transform

# ---- group: Alignment Hole
construct_point_3 = ConstructPoint(XCoordinate=series_9, YCoordinate=deconstruct.YComponent, ZCoordinate=0)
polygon_3 = Polygon(Plane=construct_point_3, Radius=Slider(1.486, range=0..3), Segments=Slider(3, range=0..3), FilletRadius=0)  # -> Polygon, Length

# ---- group: Creates an Axis for Rotating Numbers
area_2 = Area(Geometry=project.Geometry)  # -> Area, Centroid
deconstruct_2 = Deconstruct(Point=area_2.Centroid)  # -> XComponent, YComponent, ZComponent
number_slider = Slider(5, range=0..5)
addition = Addition(A=deconstruct_2.XComponent, B=number_slider)
subtraction_3 = Subtraction(A=deconstruct_2.XComponent, B=number_slider)
construct_point_4 = ConstructPoint(XCoordinate=addition, YCoordinate=deconstruct_2.YComponent, ZCoordinate=deconstruct_2.ZComponent)
construct_point_5 = ConstructPoint(XCoordinate=subtraction_3, YCoordinate=deconstruct_2.YComponent, ZCoordinate=deconstruct_2.ZComponent)
line = Line(StartPoint=construct_point_4, EndPoint=construct_point_5)

# ---- group: Add and Rotates Numbers
series_10 = Series(Start=Slider(1, range=0..1), Step=1, Count=div_slice_count)
text_on_surface = TextOnSurface(
    Text=series_10,
    Font="Sans Bold:no Italic:no",
    Height=Slider(1.176, range=0..5),
    Depth=Slider(0, range=0..1),
    BaseLine=line,
    BaseSurface=project.Geometry)
rotate_axis = RotateAxis(Geometry=text_on_surface, Angle=Slider(11, range=0..15), Axis=Line((0, 0, 0), (10, 0, 0)))  # -> Geometry, Transform
project_2 = Project(Geometry=rotate_axis.Geometry, Plane=PlaneXY(0, 0, 0))  # -> Geometry, Transform
numbers = Brep(project_2.Geometry)
