# Grasshopper definition samplertests.gh (Grasshopper 1.0.8)

# ---- group: Creates pixel plane
y_size = Slider(50, range=0..100)
pixel_size = Slider(1, range=1..5)
x_size = Slider(50, range=0..100)
division = Division(A=x_size, B=pixel_size)
division_2 = Division(A=y_size, B=pixel_size)
plane_surface = PlaneSurface(Plane=PlaneXY(0, 0, 0), XSize=x_size, YSize=y_size)  # -> reparameterize(Plane)
divide_surface = DivideSurface(Surface=plane_surface, UCount=division, VCount=division_2)  # -> Points, Normals, Parameters

# ----
image_sampler = ImageSampler(
    divide_surface.Parameters,
    FilePath="C:\Users\Ashley\Desktop\dave.png",
    Filter="Value",
    Interpolate=False,
    Umax=1,
    Umin=0,
    Vmax=1,
    Vmin=0,
    Wrap=1)

# ---- group: Flips brightness values
subtraction = Subtraction(A="1", B=image_sampler)

# ----
smaller_than = SmallerThan(FirstNumber=subtraction, SecondNumber=Slider(0.7, range=0..1))  # -> SmallerThan, OrEqualTo

# ---- group: Extrudes pixels / Constructs pixels
cull_pattern = CullPattern(List=divide_surface.Points, CullPattern=smaller_than.SmallerThan)
unit_y = UnitY(Factor=1)

# ---- group: Extrudes pixels / Constructs pixels / Constructs second point
deconstruct = Deconstruct(Point=cull_pattern)  # -> XComponent, YComponent, ZComponent
addition = Addition(A=pixel_size, B=deconstruct.XComponent)
construct_point = ConstructPoint(XCoordinate=addition, YCoordinate=deconstruct.YComponent, ZCoordinate=deconstruct.ZComponent)

# ---- group: Extrudes pixels / Constructs pixels (continued)
line = Line(StartPoint=construct_point, EndPoint=cull_pattern)
extrude = Extrude(Base=line, Direction=unit_y)

# ---- group: Extrudes pixels
# Replace with second image width
number_slider = Slider(12, range=0..20)
unit_z = UnitZ(Factor=number_slider)
extrude_2 = Extrude(Base=extrude, Direction=unit_z)
